# Grasshopper definition BarkBeetle - 4th axis knife cutting.gh (Grasshopper 1.0.7)

knife_tip_offset_from_center = Slider(3, range=0..10)
notes = Panel("""- Fix weaving
- Add overshoot?""")
angle_threshold = Slider(10, range=0..100)
safe_z_height = Slider(2, range=0..10)
cut_dpeth = Slider(2.47, range=0..10)
tolerance = Slider(0.01, range=0.01..1)
curves_to_cut = Curve([<curve referenced from the Rhino model> x7])
neg = Negative(Value=cut_dpeth)
Z = UnitZ(Factor=neg)
move = Move(Geometry=curves_to_cut, Motion=Z)  # -> Geometry, Transform
cir = Circle(Plane=PlaneXY(0, 0, 0), Radius=1)
flip = FlipCurve(Curve=move.Geometry, Guide=cir)  # -> Curve, Flag
tolerance_2 = Panel(tolerance)
knife_tip_offset_from_center_2 = Panel(knife_tip_offset_from_center)
topoly = CurveToPolyline(Curve=move.Geometry, ToleranceDistance=tolerance_2, ToleranceAngle=0)  # -> Polyline, Segments
explode = Explode(Curve=topoly.Polyline, Recursive=True)  # -> Segments, Vertices
end = EndPoints(Curve=explode.Segments)  # -> Start, End
vec2pt = Vector2Pt(PointA=end.Start, PointB=end.End, Unitize=False)  # -> Vector, Length
vec2pt_2 = Vector2Pt(PointA=end.Start, PointB=end.End, Unitize=False)  # -> Vector, Length
amp = Amplitude(Vector=vec2pt.Vector, Amplitude=knife_tip_offset_from_center_2)
X = UnitX(Factor=1)
xy = XYPlane(Origin=Point(0, 0, 0))
shift = ShiftList(List=vec2pt_2.Vector, Shift=1, Wrap=True)
move_2 = Move(Geometry=end.Start, Motion=amp)  # -> Geometry, Transform
move_3 = Move(Geometry=end.End, Motion=amp)  # -> Geometry, Transform
move_4 = Move(Geometry=explode.Segments, Motion=amp)  # -> Geometry, Transform
angle = Angle(VectorA=vec2pt_2.Vector, VectorB=X, Plane=xy)  # -> Angle, Reflex
shift_2 = ShiftList(List=move_2.Geometry, Shift=1, Wrap=True)
shift_3 = ShiftList(List=move_3.Geometry, Shift=1, Wrap=True)
deg = Degrees(Radians=angle.Angle)
angle_2 = Angle(VectorA=vec2pt_2.Vector, VectorB=shift)  # -> Angle, Reflex
ln = Line(StartPoint=move_3.Geometry, EndPoint=shift_2)
ln_2 = Line(StartPoint=move_3.Geometry, EndPoint=shift_3)
rad = Radians(Degrees=angle_threshold)
lines_for_rotating_the_knife_outside_the = Line(ln)  # "Lines for rotating the knife outside the material"
angles_for_knife_axis = Panel(deg)
panel = Panel(rad)
lines_for_cornering_in_the_material = Line(ln_2)
lines_for_cutting_straight = Line(move_4.Geometry)
larger = LargerThan(FirstNumber=angle_2.Angle, SecondNumber=rad)  # -> LargerThan, OrEqualTo
shift_4 = ShiftList(List=lines_for_cutting_straight, Shift=1, Wrap=True)
dispatch = Dispatch(List=lines_for_rotating_the_knife_outside_the, DispatchPattern=larger.LargerThan)  # -> ListA, ListB
dispatch_2 = Dispatch(List=lines_for_cornering_in_the_material, DispatchPattern=larger.LargerThan)  # -> ListA, ListB
dispatch_3 = Dispatch(List=shift_4, DispatchPattern=larger.LargerThan)  # -> ListA, ListB
crv = Curve(dispatch_2.ListB)
crv_2 = Curve(dispatch.ListA)
shift_5 = ShiftList(List=dispatch_3.ListA, Shift=-1, Wrap=True)
crv_3 = Curve(shift_5)
crv_4 = Curve(crv_2)
addition = Addition(A=safe_z_height, B=cut_dpeth)
Z_2 = UnitZ(Factor=addition)
len = Length()
move_5 = Move(Geometry=crv_4, Motion=Z_2)  # -> Geometry, Transform
multiplication = Multiplication(A=Slider(0.4535, range=0..1), B=len)
end_2 = EndPoints(Curve=crv_4)  # -> Start, End
end_3 = EndPoints(Curve=move_5.Geometry)  # -> Start, End
eval = EvaluateCurve(Parameter=multiplication)  # -> Point, Tangent, Angle
ln_3 = Line(StartPoint=end_3.End, EndPoint=end_2.End)
ln_4 = Line(StartPoint=end_2.Start, EndPoint=end_3.Start)
simplify = SimplifyTree(Tree=crv, Front=False)
simplify_2 = SimplifyTree(Tree=ln_3, Front=False)
simplify_3 = SimplifyTree(Tree=move_5.Geometry, Front=False)
simplify_4 = SimplifyTree(Tree=crv_3, Front=False)
simplify_5 = SimplifyTree(Tree=ln_4, Front=False)
panel_2 = Panel("""0
1
2
3
4""")
angles_for_knife_axis_2 = Panel(angles_for_knife_axis)
merge = Merge(Data1=simplify_4, Data2=simplify_5, Data3=simplify_3, Data4=simplify_2, Data5=simplify)
weave = Weave(
    Pattern=panel_2,
    Stream0=simplify_4,
    Stream1=simplify_5,
    Stream2=simplify_3,
    Stream3=simplify_2,
    Stream4=simplify,
    NullGaps=False)
flatten = FlattenTree(Tree=weave, Path="{0}")
lng = ListLength(List=flatten)
multiplication_2 = Multiplication(A=lng, B=Slider(0.1453, range=0..1))
item = ListItem(List=flatten, Index=multiplication_2, Wrap=True)
end_4 = EndPoints(Curve=item)  # -> Start, End
pt = Point(end_4.Start)
